# Dynamo graph AI constructor test - load.dyn (Dynamo 1.3.0.875)

# group: Inputs
file_path = Filename(".\AI IO test -NaiveBayesMachine (trained).json")
code_block = CodeBlock { name="Simple Linear Regression"; file="AI IO test - "+name+".json"; }

# group: IO
directoryName = FilePath.DirectoryName(file_path)
combine = FilePath.Combine(directoryName, code_block.file)

# group: Deserialise
load = AI.Machine.Load(combine)

# group: Inspect
name = AI.Machine.Name(load)
description = AI.Machine.Description(load)
GUID = AI.Machine.GUID(load)
getAlgorithm = AI.Machine.GetAlgorithm(load)
isTrained = AI.Machine.IsTrained(load)
result = AI.Machine.Result(load)

exists = File.Exists(combine)
