# Dynamo graph AI constructor test - save.dyn (Dynamo 1.3.0.875)

# group: Constructor
code_block = CodeBlock { 1..10; 1..100; }
simpleLinearRegression = AI.MachineLearning.Regression.SimpleLinearRegression.SimpleLinearRegression(code_block.out0, code_block.out1)
code_block_2 = CodeBlock { "TestMachine #1"; "simple machine"; }
machine = AI.Machine.Machine.Machine(simpleLinearRegression, code_block_2.out0, code_block_2.out1)

# group: Inspect
name = AI.Machine.Machine.Name(machine)
GUID = AI.Machine.Machine.GUID(machine)
getAlgorithm = AI.Machine.Machine.GetAlgorithm(machine)
name_2 = AI.MachineLearning.Regression.SimpleLinearRegression.Name(getAlgorithm)
type = AI.MachineLearning.Regression.SimpleLinearRegression.Type(getAlgorithm)

# group: Folder
file_path = Filename(".\AI constructor test.json")

# group: IO
code_block_3 = CodeBlock(machine=machine) { machine; }
directoryName = FilePath.DirectoryName(file_path)
string = StringInput("AI IO test - Simple Linear Regression.json")
combine = FilePath.Combine(directoryName, string)
saveModel = AI.Machine.Machine.SaveModel(code_block_3, combine)
